# Grasshopper definition SampleCanvas.gh (Grasshopper 1.0.7)
# plug-ins: RhinoCircular

# ----
# Copy Filepath to Folder
# Containing Libraries Here
material_library_filepath = Panel("/Users/felixheisel/Downloads/CCL- RhinoCircular/1029")
concat = Concatenate(FragmentA=material_library_filepath, FragmentB="/RC_MatLib.csv")

concat_2 = Concatenate(FragmentA=material_library_filepath, FragmentB="/Archetypes")

# ----
# Create Custom Material
prod_recycled = Slider(0, range=0..1)
material_name = Panel("Glass 1")
material_family = Panel("Glass")
material_density_kg_m3 = Panel("450")
prod_renewable = Slider(1, range=0..1)
prod_efficiency = Slider(0.5, range=0..1)
eou_recycling = Slider(0.05, range=0..1)
eou_efficiency = Slider(0.5, range=0..1)
eou_energy_rec = Slider(0.45, range=0..1)
eou_composting = Slider(0.1, range=0..1)
construct_material = ConstructMaterial(
    MaterialName=material_name,
    MaterialFamily=material_family,
    MaterialDensity=material_density_kg_m3,
    ProdRenewable=prod_renewable,
    ProdRecycled=prod_recycled,
    ProdEfficiency=prod_efficiency,
    EoURecycling=eou_recycling,
    EoUEfficiency=eou_efficiency,
    EoUEnergyRec=eou_energy_rec,
    EoUComposting=eou_composting)

# ----
# Create Custom Material
material_name_2 = Panel("Salvaged Pine")
material_family_2 = Panel("Timber")
material_density_kg_m3_2 = Panel("450")
prod_renewable_2 = Slider(1, range=0..1)
prod_recycled_2 = Slider(0, range=0..1)
prod_efficiency_2 = Slider(0.5, range=0..1)
eou_recycling_2 = Slider(0.5, range=0..1)
eou_efficiency_2 = Slider(0.5, range=0..1)
eou_energy_rec_2 = Slider(0.5, range=0..1)
eou_composting_2 = Slider(0.5, range=0..1)
construct_material_2 = ConstructMaterial(
    MaterialName=material_name_2,
    MaterialFamily=material_family_2,
    MaterialDensity=material_density_kg_m3_2,
    ProdRenewable=prod_renewable_2,
    ProdRecycled=prod_recycled_2,
    ProdEfficiency=prod_efficiency_2,
    EoURecycling=eou_recycling_2,
    EoUEfficiency=eou_efficiency_2,
    EoUEnergyRec=eou_energy_rec_2,
    EoUComposting=eou_composting_2)

# ----
# Create Custom Material
material_name_3 = Panel("Plastic 1")
material_family_3 = Panel("Plastic")
material_density_kg_m3_3 = Panel("450")
prod_renewable_3 = Slider(1, range=0..1)
prod_recycled_3 = Slider(0, range=0..1)
prod_efficiency_3 = Slider(0.5, range=0..1)
eou_recycling_3 = Slider(0.05, range=0..1)
eou_efficiency_3 = Slider(0.5, range=0..1)
eou_energy_rec_3 = Slider(0.45, range=0..1)
eou_composting_3 = Slider(0.1, range=0..1)
construct_material_3 = ConstructMaterial(
    MaterialName=material_name_3,
    MaterialFamily=material_family_3,
    MaterialDensity=material_density_kg_m3_3,
    ProdRenewable=prod_renewable_3,
    ProdRecycled=prod_recycled_3,
    ProdEfficiency=prod_efficiency_3,
    EoURecycling=eou_recycling_3,
    EoUEfficiency=eou_efficiency_3,
    EoUEnergyRec=eou_energy_rec_3,
    EoUComposting=eou_composting_3)

concat_3 = Concatenate(FragmentA=concat_2, FragmentB="/AtticFloorCeiling_Unfinished.csv")
path = FilePath(concat)

# ----
# Load Archetype from File
load_ml = LoadMaterialLibraryFromCSV(CSVFilePath=path)
file_path = FilePath(concat_3)

# ----
# RC Material
data = Data(construct_material_2)

# ----
# Create Custom Item
item_name = Panel("Item 2")
reused = Slider(0.25, range=0..1)
geometry = Geometry(<brep referenced from the Rhino model>)
construct_rc_item = ConstructRCItem(ItemName=item_name, RCMaterial=data, Geometry=geometry, Reused=reused)  # -> RCItem, GUID

# ----
# Create Custom Archetype
archetype_name = Panel("Archetype 1")
layer_thickness = Panel("""1
90
90""")
fill = Panel("""1
.7
.3""")
panel = Panel("""0.5
0.4
0""")
layer_thickness_2 = Panel("""1
2
2""")
data_2 = Data(construct_material)
data_3 = Data(data)
data_4 = Data(construct_material_3)
construct_archetype = ConstructArchetype(
    ArchetypeName=archetype_name,
    LayerNumber=layer_thickness_2,
    RCMaterial=flatten([data_3, data_2, data_4]),
    LayerThickness=layer_thickness,
    LayerFill=fill,
    Reusability=panel)

# ----
# RC Item
data_5 = Data(construct_rc_item.RCItem)

# ----
# RC Archetype
data_6 = Data(construct_archetype)

# ----
# Designed for Disassembly
reusability = Panel(".4")
designed_for_dissassembly = DesignedForDissassembly(RCItem=data_5, Reusability=reusability)

# ----
# Create SubAssembly
data_7 = Data(flatten(designed_for_dissassembly))
sub_assembly_name = Panel("Sub-Assembly 2")
list = ValueList({"Skin", "Structure", "Service", "Spaceplan", "Stuff", "Unknown"}, selected="Skin")
construct_sub_assembly = ConstructSubAssembly(SubAssemblyName=sub_assembly_name, RCItemS=data_7, ShearingLayer=list)

# ----
# SubAssembly from Archetype
geometry_2 = Geometry(<brep referenced from the Rhino model>)
list_2 = ValueList({"Skin", "Structure", "Service", "Spaceplan", "Stuff", "Unknown"}, selected="Skin")
sub_assembly_from_archetype = SubAssemblyFromArchetype(Archetype=data_6, Geometry=geometry_2, ShearingLayer=list_2)

# ----
# SubAssembly from Archetype
geometry_3 = Geometry(<brep referenced from the Rhino model>)
sub_assemblies_from_archetype_file = SubAssembliesFromArchetypeFile(FilePath=file_path, MaterialLibrary=load_ml, Geometry=geometry_3)

# ----
# Deconstruct Archetype
deconstruct_archetype = DeconstructArchetype(Archetype=data_6)  # -> ArchetypeName, LayerNumber, Material, LayerThickness, LayerFill, Reusability
panel_2 = Panel(deconstruct_archetype.Material)
panel_3 = Panel(deconstruct_archetype.LayerThickness)
panel_4 = Panel(deconstruct_archetype.LayerFill)
panel_5 = Panel(deconstruct_archetype.Reusability)
panel_6 = Panel(deconstruct_archetype.LayerNumber)
panel_7 = Panel(deconstruct_archetype.ArchetypeName)

# ----
# RC SubAssembly
data_8 = Data(sub_assemblies_from_archetype_file)

# ----
# RC SubAssembly
data_9 = Data(sub_assembly_from_archetype)

# ----
# RC SubAssembly
data_10 = Data(construct_sub_assembly)

building_name = Panel("Building 1")
buidling_location = Panel("United States")
configure_global_parameters = ConfigureGlobalParameters(BuildingName=building_name, BuildingLocation=buidling_location)

# ----
# Export Materials to CSV file
panel_8 = Panel("RC_Materials.csv")
file_path_2 = FilePath(material_library_filepath)

# ----
# Select Material from CSV file
file_path_3 = FilePath(concat)
material_family_4 = Panel("Mineral")
material_name_4 = Panel("Brick")

load_material_library_from_csv = LoadMaterialLibraryFromCSV(CSVFilePath=file_path_3)

select_material = SelectMaterial(MaterialLibrary=load_material_library_from_csv, MaterialFamily=material_family_4, MaterialName=material_name_4)

export_material_library = ExportMaterialLibrary(MaterialLibrary=load_material_library_from_csv, FilePath=file_path_2, FileName=panel_8)

# ----
# RC Material
data_11 = Data(select_material)

# ----
# Deconstruct Material
deconstruct_rc_material = DeconstructRCMaterial(RCMaterial=data_11)  # -> MaterialName, MaterialFamily, MaterialID, MaterialDensity, ProdRenewable, ProdRecycled, ProdEfficiency, EoURecycling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
panel_9 = Panel(deconstruct_rc_material.MaterialFamily)
panel_10 = Panel(deconstruct_rc_material.MaterialID)
panel_11 = Panel(deconstruct_rc_material.MaterialDensity)
panel_12 = Panel(deconstruct_rc_material.ProdRenewable)
panel_13 = Panel(deconstruct_rc_material.ProdRecycled)
panel_14 = Panel(deconstruct_rc_material.ProdEfficiency)
panel_15 = Panel(deconstruct_rc_material.EoURecycling)
panel_16 = Panel(deconstruct_rc_material.EoUEfficiency)
panel_17 = Panel(deconstruct_rc_material.EoUEnergyRec)
panel_18 = Panel(deconstruct_rc_material.EoUComposting)
panel_19 = Panel(deconstruct_rc_material.MaterialName)

# ----
# Create Item
item_name_2 = Panel("Item 1")
reused_2 = Slider(0.25, range=0..1)
geometry_4 = Geometry(<brep referenced from the Rhino model>)
construct_rc_item_2 = ConstructRCItem(ItemName=item_name_2, RCMaterial=data_11, Geometry=geometry_4, Reused=reused_2)  # -> RCItem, GUID

# ----
# RC Item
data_12 = Data(construct_rc_item_2.RCItem)

# ----
# Deconstruct Item
deconstruct_item = DeconstructItem(RCItem=data_12)  # -> ItemName, RCMaterial, Geometry, Reused
panel_20 = Panel(deconstruct_item.RCMaterial)
panel_21 = Panel(deconstruct_item.Geometry)
panel_22 = Panel(deconstruct_item.Reused)
panel_23 = Panel(deconstruct_item.ItemName)

# ----
# Designed for Disassembly
reusability_2 = Panel(".4")
designed_for_dissassembly_2 = DesignedForDissassembly(RCItem=data_12, Reusability=reusability_2)

# ----
# Create SubAssembly
data_13 = Data(flatten(designed_for_dissassembly_2))
sub_assembly_name_2 = Panel("Sub-Assembly 1")
list_3 = ValueList({"Skin", "Structure", "Service", "Spaceplan", "Stuff", "Unknown"}, selected="Structure")
construct_sub_assembly_2 = ConstructSubAssembly(SubAssemblyName=sub_assembly_name_2, RCItemS=data_13, ShearingLayer=list_3)

# ----
# RC SubAssembly
data_14 = Data(construct_sub_assembly_2)

# ----
# Deconstruct Sub-Assembly
deconstruct_sub_assembly = DeconstructSubAssembly(SubAssembly=data_14)  # -> SubAssemblyName, RCItemS, ShearingLayer
sub_assembly_name_3 = Panel(deconstruct_sub_assembly.SubAssemblyName)
rc_items = Panel(deconstruct_sub_assembly.RCItemS)
shearing_layer = Panel(deconstruct_sub_assembly.ShearingLayer)

# ----
# Create Assembly
assembly_name = Panel("Assembly 1")
construct_assembly = ConstructAssembly(AssemblyName=assembly_name, SubAssembly=flatten([data_14, data_10, data_8, data_9]))

# ----
# Calculate Material Passport
building_name_2 = Panel("Passport 1")
calculate_material_passport = CalculateMaterialPassport(MaterialPassportName=building_name_2, RhinoCircularObject=construct_assembly)

# ----
# Deconstruct Assembly
deconstruct_assembly = DeconstructAssembly(Assembly=construct_assembly)
sub_assembly = Panel(deconstruct_assembly)

# ----
# Export Material Passport to CSV
material_passport_export_filepath = Panel("COPY FILEPATH HERE")
file_path_4 = FilePath(material_passport_export_filepath)
export_material_passport = ExportMaterialPassport(MaterialPassport=calculate_material_passport, ExportPath=file_path_4, Generate=Button())

# ----
# Export Object to JSON
material_passport_export_filepath_2 = Panel("COPY FILEPATH HERE")
file_path_5 = FilePath(material_passport_export_filepath_2)
export_materials_passport_json = ExportMaterialsPassportJson(RhinoCircularObj=construct_assembly, ExportPath=file_path_5, Generate=Button())

# ----
# Display Material Passport
button = Button()
point = Point(Point(0, 0, 0))
display_material_passport = DisplayMaterialPassport(Location=point, MaterialPassport=calculate_material_passport, Generate=Button(), Dispose=button)  # -> Output, Output_2
